# Grasshopper definition chess.gh (Grasshopper 1.0.7)

toggle = BooleanToggle(False)
button = Button()
rook = Geometry(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)
pawn = Geometry(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)
knight = Geometry(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)
bishop = Geometry(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)
queen = Geometry(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)
king = Geometry(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)
rotate = Rotate(Geometry=knight, Angle=3.141592654, Plane=PlaneXY(0, 0, 0))  # -> Geometry, Transform
c_script = CSharpScript(reset=button, active=toggle)  # -> out, pb, pw, jb, jw, TC; inputs reset: Boolean, active: Boolean
# ---------- c_script: C# usings ----------
using Rhino.DocObjects;
using System.Linq;
using System.Drawing;
# ---------- c_script: C# ----------
    var doc = RhinoDoc.ActiveDoc;


    RhinoDoc.SelectObjects -= SelectObjectEventHandler;
    if(active)
    {
      RhinoDoc.SelectObjects += SelectObjectEventHandler;
      if(turnCount == 0)
      {
        ExtractObjects();
        Lock();
      }

    }else
    {
      originGuid = Guid.Empty;
      var ids = RhinoDocument.Objects.FindByUserString("key_02", "value_01", false).Select(ro => ro.Id);
      RhinoDocument.Objects.Delete(ids, true);
      turnCount = 0;
      job = null;
      //UnLock();
    }

    if(reset)
    {
      turnCount = 0;
      job = null;
      Array.Clear(blackObjects, 0, blackObjects.Length);
      Array.Clear(whiteObjects, 0, whiteObjects.Length);
    }
    pb = places_Black;
    pw = places_White;
    if(blackObjects != null) jb = blackObjects.Select(obj => obj.Attributes.GetUserString("Job"));
    if(whiteObjects != null) jw = whiteObjects.Select(obj => obj.Attributes.GetUserString("Job"));
    TC = turnCount;
# ---------- c_script: C# additional code ----------
  //Init
  Guid originGuid;
  List<Guid> followerGuids;
  //Option
  float gridSize = 5;
  int turnCount = 0;
  //All Objects Info
  RhinoObject[] blackObjects;
  RhinoObject[] whiteObjects;
  IEnumerable<Point3f> places_Black;
  IEnumerable<Point3f> places_White;
  //UserStrings
  string color;
  string job;

  void ExtractObjects()
  {
    blackObjects = RhinoDocument.Objects.FindByUserString("Color", "Black", false);
    whiteObjects = RhinoDocument.Objects.FindByUserString("Color", "White", false);
    places_Black = blackObjects.Select(ro => (Point3f) AreaMassProperties.Compute(ro.Geometry as Brep).Centroid);
    places_White = whiteObjects.Select(ro => (Point3f) AreaMassProperties.Compute(ro.Geometry as Brep).Centroid);
  }

  void SelectObjectEventHandler(object sender, RhinoObjectSelectionEventArgs e)
  {
    var selObjects = RhinoDocument.Objects.Where(obj => obj.IsSelected(false) > 0).ToList();
    RhinoDocument.Objects.UnselectAll();
    if(selObjects.Count > 1) return;
    if(selObjects.Count == 1)
    {

      if(selObjects[0].Attributes.GetUserString("Color") != null)
      {
        //Delete follower objects before
        var ids = RhinoDocument.Objects.FindByUserString("key_02", "value_01", false).Select(ro => ro.Id);
        RhinoDocument.Objects.Delete(ids, true);
        //Get selected object Guid
        Guid id = selObjects[0].Id;
        //if now id == before id
        if(originGuid == id)
        {
          originGuid = Guid.Empty;
          return;
        }
        //Get selected object UserStrings
        color = selObjects[0].Attributes.GetUserString("Color");
        job = selObjects[0].Attributes.GetUserString("Job");
        //Get selected object RhinoObject
        Brep geometry = selObjects[0].Geometry as Brep;
        //Add FollowerObjects and Guids
        followerGuids = AddFollowBreps(geometry);
        //Memory now id
        originGuid = id;
      }

      if(selObjects[0].Attributes.GetUserString("key_02") != null)
      {
        //Get selected object RhinoObject
        Brep geometry = selObjects[0].Geometry as Brep;
        //Delete All
        RhinoDocument.Objects.Delete(followerGuids, true);
        RhinoDocument.Objects.Delete(originGuid, true);
        //Add new object
        AddOriginBrep(geometry);
        //if overlapped delete enemy
        DelEnemy(geometry);

        followerGuids = new List<Guid>();
        originGuid = Guid.Empty;
        turnCount++;
        ExtractObjects();
        Lock();
      }
      this.Component.ExpireSolution(true);
    }

  }



  List<Guid> AddFollowBreps(Brep geometry)
  {

    //init attribute
    ObjectAttributes attrib = RhinoDocument.CreateDefaultAttributes();
    attrib.SetUserString("key_02", "value_01");
    attrib.ColorSource = ObjectColorSource.ColorFromObject;
    attrib.ObjectColor = Color.Red;
    attrib.RenderMaterial = CreateRenderMaterial("red", Color.Red, 0.5);
    //init Guids
    List<Guid> guids = new List<Guid>();

    if(job == "Pawn") PawnMove(geometry, ref guids, attrib);

    if(job == "Knight") KnightMove(geometry, ref guids, attrib);

    if(job == "Rook")
    {
      int maxStep = 8;
      Vector3f rayDirection = new Vector3f(0, gridSize, 0);
      RayMarching(geometry, rayDirection, maxStep, ref guids, attrib);

      rayDirection = new Vector3f(gridSize, 0, 0);
      RayMarching(geometry, rayDirection, maxStep, ref guids, attrib);

      rayDirection = new Vector3f(0, -gridSize, 0);
      RayMarching(geometry, rayDirection, maxStep, ref guids, attrib);

      rayDirection = new Vector3f(-gridSize, 0, 0);
      RayMarching(geometry, rayDirection, maxStep, ref guids, attrib);
    }

    if(job == "Bishop")
    {
      int maxStep = 8;
      Vector3f rayDirection = new Vector3f(gridSize, gridSize, 0);
      RayMarching(geometry, rayDirection, maxStep, ref guids, attrib);

      rayDirection = new Vector3f(-gridSize, gridSize, 0);
      RayMarching(geometry, rayDirection, maxStep, ref guids, attrib);

      rayDirection = new Vector3f(gridSize, -gridSize, 0);
      RayMarching(geometry, rayDirection, maxStep, ref guids, attrib);

      rayDirection = new Vector3f(-gridSize, -gridSize, 0);
      RayMarching(geometry, rayDirection, maxStep, ref guids, attrib);
    }

    if(job == "Queen")
    {
      int maxStep = 8;
      Vector3f rayDirection = new Vector3f(0, gridSize, 0);
      RayMarching(geometry, rayDirection, maxStep, ref guids, attrib);

      rayDirection = new Vector3f(gridSize, 0, 0);
      RayMarching(geometry, rayDirection, maxStep, ref guids, attrib);

      rayDirection = new Vector3f(0, -gridSize, 0);
      RayMarching(geometry, rayDirection, maxStep, ref guids, attrib);

      rayDirection = new Vector3f(-gridSize, 0, 0);
      RayMarching(geometry, rayDirection, maxStep, ref guids, attrib);

      rayDirection = new Vector3f(gridSize, gridSize, 0);
      RayMarching(geometry, rayDirection, maxStep, ref guids, attrib);

      rayDirection = new Vector3f(-gridSize, gridSize, 0);
      RayMarching(geometry, rayDirection, maxStep, ref guids, attrib);

      rayDirection = new Vector3f(gridSize, -gridSize, 0);
      RayMarching(geometry, rayDirection, maxStep, ref guids, attrib);

      rayDirection = new Vector3f(-gridSize, -gridSize, 0);
      RayMarching(geometry, rayDirection, maxStep, ref guids, attrib);
    }

    if(job == "King")
    {
      int maxStep = 1;
      Vector3f rayDirection = new Vector3f(0, gridSize, 0);
      RayMarching(geometry, rayDirection, maxStep, ref guids, attrib);

      rayDirection = new Vector3f(gridSize, 0, 0);
      RayMarching(geometry, rayDirection, maxStep, ref guids, attrib);

      rayDirection = new Vector3f(0, -gridSize, 0);
      RayMarching(geometry, rayDirection, maxStep, ref guids, attrib);

      rayDirection = new Vector3f(-gridSize, 0, 0);
      RayMarching(geometry, rayDirection, maxStep, ref guids, attrib);

      rayDirection = new Vector3f(gridSize, gridSize, 0);
      RayMarching(geometry, rayDirection, maxStep, ref guids, attrib);

      rayDirection = new Vector3f(-gridSize, gridSize, 0);
      RayMarching(geometry, rayDirection, maxStep, ref guids, attrib);

      rayDirection = new Vector3f(gridSize, -gridSize, 0);
      RayMarching(geometry, rayDirection, maxStep, ref guids, attrib);

      rayDirection = new Vector3f(-gridSize, -gridSize, 0);
      RayMarching(geometry, rayDirection, maxStep, ref guids, attrib);
    }
    //conditions & init




    return guids;
  }

  void AddOriginBrep(Brep geometry)
  {
    Rhino.DocObjects.ObjectAttributes attrib = RhinoDocument.CreateDefaultAttributes();
    attrib.SetUserString("Color", color);
    attrib.SetUserString("Job", job);
    attrib.RenderMaterial = CreateRenderMaterial("trans", System.Drawing.Color.White, 1);
    RhinoDocument.Objects.Add(geometry, attrib);
  }

  void DelEnemy(Brep geometry)
  {
    Point3f center = (Point3f) AreaMassProperties.Compute(geometry).Centroid;
    if(color == "Black" && places_White.Contains(center))
    {
      Guid id = whiteObjects.Where(ro => (Point3f) AreaMassProperties.Compute(ro.Geometry as Brep).Centroid == center).Select(ro => ro.Id).ToList()[0];
      RhinoDocument.Objects.Unlock(id, true);
      RhinoDocument.Objects.Delete(id, true);
    }
    if(color == "White" && places_Black.Contains(center))
    {
      Guid id = blackObjects.Where(ro => (Point3f) AreaMassProperties.Compute(ro.Geometry as Brep).Centroid == center).Select(ro => ro.Id).ToList()[0];
      RhinoDocument.Objects.Unlock(id, true);
      RhinoDocument.Objects.Delete(id, true);
    }

  }

  void Lock()
  {

    if(turnCount % 2 == 0)
    {
      blackObjects.ToList().ForEach(k => RhinoDocument.Objects.Lock(k, true));
      whiteObjects.ToList().ForEach(k => RhinoDocument.Objects.Unlock(k, true));
    }else
    {
      whiteObjects.ToList().ForEach(k => RhinoDocument.Objects.Lock(k, true));
      blackObjects.ToList().ForEach(k => RhinoDocument.Objects.Unlock(k, true));
    }
  }

  void UnLock()
  {
    if(whiteObjects != null && blackObjects != null)
    {
      whiteObjects.ToList().ForEach(k => RhinoDocument.Objects.Unlock(k, true));
      blackObjects.ToList().ForEach(k => RhinoDocument.Objects.Unlock(k, true));
    }
  }


  void RayMarching(Brep geometry, Vector3f rayDirection, int maxStep, ref List<Guid> guids, ObjectAttributes attrib)
  {
    //Queen, Bishop, Rook

    Vector3f initVec = new Vector3f(0, 0, 0);

    Brep _geometry = geometry.DuplicateBrep();

    Point3f center = (Point3f) AreaMassProperties.Compute(geometry).Centroid;
    float k = gridSize * 8;

    for(int i = 0; i < maxStep ; i++)
    {
      _geometry.Translate(rayDirection);
      center += rayDirection;

      bool isOutBorder = IsOutBorder(center);
      if(color == "Black")
      {
        if(isOutBorder || places_Black.Contains(center)) break;
        guids.Add(RhinoDocument.Objects.Add(_geometry, attrib));
        if(places_White.Contains(center)) break;
      }

      if(color == "White")
      {
        if(isOutBorder || places_White.Contains(center)) break;
        guids.Add(RhinoDocument.Objects.Add(_geometry, attrib));
        if(places_Black.Contains(center)) break;
      }

    }

  }

  void PawnMove(Brep geometry, ref List<Guid> guids, ObjectAttributes attrib)
  {
    Brep _geometry;
    Point3f center = (Point3f) AreaMassProperties.Compute(geometry).Centroid;
    Vector3f rayDirection = new Vector3f(0, gridSize, 0);
    int step = 1;

    if(color == "White")
    {
      if(((center.Y + gridSize / 2) / gridSize) == 2) step = 2;
      Vector3f vec = new Vector3f(gridSize, gridSize, 0);
      if(places_Black.Contains(center + vec))
      {
        _geometry = geometry.DuplicateBrep();
        _geometry.Translate(vec);
        guids.Add(RhinoDocument.Objects.Add(_geometry, attrib));
      }
      vec.X *= -1;
      if(places_Black.Contains(center + vec))
      {
        _geometry = geometry.DuplicateBrep();
        _geometry.Translate(vec);
        guids.Add(RhinoDocument.Objects.Add(_geometry, attrib));
      }
    }

    if(color == "Black")
    {
      rayDirection *= -1;
      if(((center.Y + gridSize / 2) / gridSize) == 7) step = 2;
      Vector3f vec = new Vector3f(-gridSize, -gridSize, 0);
      if(places_White.Contains(center + vec))
      {
        _geometry = geometry.DuplicateBrep();
        _geometry.Translate(vec);
        guids.Add(RhinoDocument.Objects.Add(_geometry, attrib));
      }
      vec.X *= -1;
      if(places_White.Contains(center + vec))
      {
        _geometry = geometry.DuplicateBrep();
        _geometry.Translate(vec);
        guids.Add(RhinoDocument.Objects.Add(_geometry, attrib));
      }
    }

    float k = gridSize * 8;
    _geometry = geometry.DuplicateBrep();
    for(int i = 0; i < step; i++)
    {
      _geometry.Translate(rayDirection);
      center += rayDirection;
      bool isOutBorder = IsOutBorder(center);
      if(isOutBorder || places_Black.Contains(center) || places_White.Contains(center)) break;
      guids.Add(RhinoDocument.Objects.Add(_geometry, attrib));
    }

  }

  void KnightMove(Brep geometry, ref List<Guid> guids, ObjectAttributes attrib)
  {

    Point3f center = (Point3f) AreaMassProperties.Compute(geometry).Centroid;

    Vector3f vecx = new Vector3f(1, 0, 0);
    Vector3f vecy = new Vector3f(0, 1, 0);

    Vector3f[] vectors = new Vector3f[8]{
      vecx + vecy * 2,
      vecx * 2 + vecy,
      vecx * 2 + vecy * (-1),
      vecx + vecy * 2 * (-1),
      vecx * (-1) + vecy * 2 * (-1),
      vecx * 2 * (-1) + vecy * (-1),
      vecx * 2 * (-1) + vecy,
      vecx * (-1) + vecy * 2
      };

    foreach(Vector3f vec in vectors)
    {
      Point3f c = center + vec * gridSize;

      if(color == "White" && (IsOutBorder(c) || places_White.Contains(c))) continue;
      if(color == "Black" && (IsOutBorder(c) || places_Black.Contains(c))) continue;

      Brep _geometry = geometry.DuplicateBrep();
      _geometry.Translate(vec * gridSize);
      guids.Add(RhinoDocument.Objects.Add(_geometry, attrib));
    }
  }

  bool IsOutBorder(Point3f center)
  {
    float k = gridSize * 8;
    return center.X > k || center.X < 0 || center.Y > k || center.Y < 0;
  }

  Rhino.Render.RenderMaterial CreateRenderMaterial(string name, System.Drawing.Color col, double transparency)
  {
    var rmts = RhinoDocument.RenderMaterials.Where(rm => rm.Name == name);
    if(!rmts.Any())
    {
      Material mat = new Material();
      mat.DiffuseColor = col;
      mat.Name = name;
      mat.Transparency = transparency;
      Rhino.Render.RenderMaterial rMat = Rhino.Render.RenderMaterial.CreateBasicMaterial(mat, RhinoDocument);
      RhinoDocument.RenderMaterials.Add(rMat);
    }
    return rmts.ElementAt(0);
  }
# ---------- end c_script ----------
c_script_2 = CSharpScript(active=toggle, tc=c_script.TC)  # -> A; inputs active: Boolean, tc: Int32
# ---------- c_script_2: C# usings ----------
using System.Linq;
using Grasshopper.Kernel.Special;
# ---------- c_script_2: C# ----------
    var enm = GrasshopperDocument.Objects.Where(i => i.GetType().ToString() == "Grasshopper.Kernel.Special.GH_Timer");
    GH_Timer whiteTimer = enm.Where(i => i.NickName == "whiteTime").ElementAt(0) as GH_Timer;
    GH_Timer blackTimer = enm.Where(i => i.NickName == "blackTime").ElementAt(0) as GH_Timer;
    if(active)
    {
      if(tc % 2 == 0)
      {
        whiteTimer.Locked = false;
        blackTimer.Locked = true;
      }else
      {
        whiteTimer.Locked = true;
        blackTimer.Locked = false;
      }
    }else
    {
      whiteTimer.Locked = true;
      blackTimer.Locked = true;
    }
# ---------- end c_script_2 ----------
c_script_3 = CSharpScript(reset=button)  # inputs reset: Boolean
# ---------- c_script_3: C# usings ----------
using Rhino.DocObjects;
using System.Linq;
using Rhino.Render;
# ---------- c_script_3: C# ----------
    float gs = 5;
    List<Brep> breps = new List<Brep>();
    Brep originBrep = Brep.CreateFromCornerPoints(new Point3d(0, 0, 0), new Point3d(gs, 0, 0), new Point3d(gs, gs, 0), new Point3d(0, gs, 0), 0.1);
    if(reset)
    {
      //delete past objects
      RhinoObject[] blackObjects = RhinoDocument.Objects.FindByUserString("Color", "Black", true);
      RhinoObject[] whiteObjects = RhinoDocument.Objects.FindByUserString("Color", "White", true);
      blackObjects.ToList().ForEach(obj => RhinoDocument.Objects.Delete(obj, true, true));
      whiteObjects.ToList().ForEach(obj => RhinoDocument.Objects.Delete(obj, true, true));

      //generate new objects
      Brep copyBrep1 = originBrep.DuplicateBrep();
      Brep copyBrep2 = originBrep.DuplicateBrep();
      Brep copyBrep3 = originBrep.DuplicateBrep();
      Brep copyBrep4 = originBrep.DuplicateBrep();
      copyBrep2.Translate(new Vector3f(0, gs, 0));
      copyBrep3.Translate(new Vector3f(0, gs * 6, 0));
      copyBrep4.Translate(new Vector3f(0, gs * 7, 0));
      ObjectAttributes attrib1 = RhinoDocument.CreateDefaultAttributes();
      ObjectAttributes attrib2 = RhinoDocument.CreateDefaultAttributes();

      //setMaterial
      RenderMaterial rmt = CreateRenderMaterial("trans", System.Drawing.Color.White, 1);
      attrib1.RenderMaterial = rmt;
      attrib2.RenderMaterial = rmt;

      for(int i = 0; i < 8; i++)
      {
        //Set UserString "Job"
        string job = null;
        if(i == 0 || i == 7) job = "Rook";
        if(i == 1 || i == 6) job = "Knight";
        if(i == 2 || i == 5) job = "Bishop";
        if(i == 3) job = "Queen";
        if(i == 4) job = "King";
        attrib1.SetUserString("Job", job);
        attrib2.SetUserString("Job", "Pawn");

        //white
        attrib1.SetUserString("Color", "White");
        attrib2.SetUserString("Color", "White");

        RhinoDocument.Objects.AddBrep(copyBrep1, attrib1);
        copyBrep1.Translate(new Vector3f(gs, 0, 0));

        RhinoDocument.Objects.AddBrep(copyBrep2, attrib2);
        copyBrep2.Translate(new Vector3f(gs, 0, 0));

        //black
        attrib1.SetUserString("Color", "Black");
        attrib2.SetUserString("Color", "Black");

        RhinoDocument.Objects.AddBrep(copyBrep3, attrib2);
        copyBrep3.Translate(new Vector3f(gs, 0, 0));

        RhinoDocument.Objects.AddBrep(copyBrep4, attrib1);
        copyBrep4.Translate(new Vector3f(gs, 0, 0));
      }
    }
# ---------- c_script_3: C# additional code ----------
  Rhino.Render.RenderMaterial CreateRenderMaterial(string name, System.Drawing.Color col, double transparency)
  {
    var rmts = RhinoDocument.RenderMaterials.Where(rm => rm.Name == name);
    if(!rmts.Any())
    {
      Material mat = new Material();
      mat.DiffuseColor = col;
      mat.Name = name;
      mat.Transparency = transparency;
      Rhino.Render.RenderMaterial rMat = Rhino.Render.RenderMaterial.CreateBasicMaterial(mat, RhinoDocument);
      RhinoDocument.RenderMaterials.Add(rMat);
    }
    return rmts.ElementAt(0);
  }
# ---------- end c_script_3 ----------
merge = Merge(Data1=pawn, Data2=rook, Data3=knight, Data4=bishop, Data5=queen, Data6=king)
c_script_4 = CSharpScript(reset=button)  # inputs reset: Boolean
# ---------- c_script_4: C# ----------
    float gs = 5;
    List<Brep> breps = new List<Brep>();
    Brep originBrep = Brep.CreateFromCornerPoints(new Point3d(0, 0, 0), new Point3d(gs, 0, 0), new Point3d(gs, gs, 0), new Point3d(0, gs, 0), 0.1);
    if(reset)
    {
      //delete past objects
      RhinoObject[] boardObjects = RhinoDocument.Objects.FindByUserString("Board", "Board", true);
      if(boardObjects.Any())
      {
        boardObjects.ToList().ForEach(obj => RhinoDocument.Objects.Delete(obj, true, true));
      }

      //generate new objects


      ObjectAttributes attrib = RhinoDocument.CreateDefaultAttributes();

      //set UserStrings
      attrib.SetUserString("Board", "Board");

      //init Materials
      RenderMaterial black = CreateRenderMaterial("black", System.Drawing.Color.Black, 0);
      RenderMaterial white = CreateRenderMaterial("white", System.Drawing.Color.White, 0);

      Vector3f dx = new Vector3f(gs, 0, 0);
      Vector3f dy = new Vector3f(0, gs, 0);
      Vector3f vecY = new Vector3f(0, 0, 0);
      for(int y = 0; y < 8; y++)
      {

        Vector3f vecX = new Vector3f(0, 0, 0);
        for(int x = 0; x < 8; x++)
        {
          Brep copyBrep = originBrep.DuplicateBrep();
          copyBrep.Translate(vecY + vecX);

          if((x + y) % 2 == 1)
          {
            attrib.RenderMaterial = white;
          }else
          {
            attrib.RenderMaterial = black;
          }

          Guid id = RhinoDocument.Objects.AddBrep(copyBrep, attrib);
          RhinoDocument.Objects.Lock(id, true);
          
          vecX += dx;
        }

        vecY += dy;
      }



    }
# ---------- c_script_4: C# additional code ----------
  Rhino.Render.RenderMaterial CreateRenderMaterial(string name, System.Drawing.Color col, double transparency)
  {
    var rmts = RhinoDocument.RenderMaterials.Where(rm => rm.Name == name);
    if(!rmts.Any())
    {
      Material mat = new Material();
      mat.DiffuseColor = col;
      mat.Name = name;
      mat.Transparency = transparency;
      Rhino.Render.RenderMaterial rMat = Rhino.Render.RenderMaterial.CreateBasicMaterial(mat, RhinoDocument);
      RhinoDocument.RenderMaterials.Add(rMat);
    }
    return rmts.ElementAt(0);
  }
# ---------- end c_script_4 ----------
merge_2 = Merge(Data1=pawn, Data2=rook, Data3=rotate.Geometry, Data4=bishop, Data5=queen, Data6=king)
whitetime = Trigger(Interval=1000, TimerInterval=1000, Target=c_script_8)  # disabled
blacktime = Trigger(Interval=1000, TimerInterval=1000, Target=c_script_7)  # disabled
c_script_5 = CSharpScript(name=c_script.jw)  # -> A; inputs name: String
# ---------- c_script_5: C# ----------
    switch(name)
    {
      case "Pawn":
        A = 0;
        break;
      case "Rook":
        A = 1;
        break;
      case "Knight":
        A = 2;
        break;
      case "Bishop":
        A = 3;
        break;
      case "Queen":
        A = 4;
        break;
      case "King":
        A = 5;
        break;
    }
# ---------- end c_script_5 ----------
c_script_6 = CSharpScript(name=c_script.jb)  # -> A; inputs name: String; same code as c_script_5
item = ListItem(List=merge, Index=c_script_5, Wrap=True)
item_2 = ListItem(List=merge_2, Index=c_script_6, Wrap=True)
c_script_7 = CSharpScript(reset=button)  # -> out, A; inputs reset: Boolean
# ---------- c_script_7: C# ----------
    i++;
    if(b && !reset)
    {
      i = 0;
    }

    b = reset;
    A = String.Format("{0:00}:{1:00}", i / 60, i % 60);
# ---------- c_script_7: C# additional code ----------
  int i = 0;
  bool b = false;
# ---------- end c_script_7 ----------
move = Move(Geometry=item_2, Motion=c_script.pb)  # -> Geometry, Transform
c_script_8 = CSharpScript(reset=button)  # -> out, A; inputs reset: Boolean; same code as c_script_7
c_script_9 = CSharpScript(name=c_script.jw)  # -> str; inputs name: list of String
# ---------- c_script_9: C# usings ----------
using System.Linq;
# ---------- c_script_9: C# ----------
        /*
    pawn = name.Where(k => k == "Pawn").Count();
    knight = name.Where(k => k == "Knight").Count();
    rook = name.Where(k => k == "Rook").Count();
    bishop = name.Where(k => k == "Bishop").Count();
    queen = name.Where(k => k == "Queen").Count();
    king = name.Where(k => k == "King").Count();
    */
    str = String.Format("{0}: {1}\n{2}: {3}\n{4}: {5}\n{6}: {7}\n{8}: {9}\n{10}: {11}",
      "pawn", name.Where(k => k == "Pawn").Count(),
      "knight", name.Where(k => k == "Knight").Count(),
      "rook", name.Where(k => k == "Rook").Count(),
      "bishop", name.Where(k => k == "Bishop").Count(),
      "queen", name.Where(k => k == "Queen").Count(),
      "king", name.Where(k => k == "King").Count()
      );
# ---------- end c_script_9 ----------
c_script_10 = CSharpScript(name=c_script.jb)  # -> str; inputs name: list of String; same code as c_script_9
pt = Point(Point(46.53931538, 30.02901805, 0))
move_2 = Move(Geometry=item, Motion=c_script.pw)  # -> Geometry, Transform
pt_2 = Point(Point(47.11301478, 26.82561741, 0))
pl = ConstructPlane(Origin=pt, XAxis=Vector(-10.08436423, 0, 0), YAxis=Vector(0, -14.36181643, 0))
pt_3 = Point(Point(42.27655058, 10.07872364, 0))
pl_2 = ConstructPlane(Origin=pt_2, XAxis=Vector(-11.48436915, 0, 0), YAxis=Vector(0, -14.36181643, 0))
pt_4 = Point(Point(42.25592389, 8.090011817, 0))
tag = TextTag3D(Location=pl_2, Text=c_script_7.A, Size=2, Justification=7)
tag_2 = TextTag3D(Location=pt_3, Text=c_script_8.A, Size=2, Justification=7)
tag_3 = TextTag3D(Location=pt_4, Text=c_script_9, Size=1, Justification=7)
tag_4 = TextTag3D(Location=pl, Text=c_script_10, Size=1, Justification=7)
preview = CustomPreview(Geometry=move_2.Geometry, Material=ColourSwatch(SwatchColor=RGB(235, 235, 235)))
preview_2 = CustomPreview(Geometry=move.Geometry, Material=ColourSwatch(SwatchColor=RGB(54, 54, 54)))
rectangle = Rectangle(Plane=pl_2, XSize=Domain(0, 6.5), YSize=Domain(0, 2.1), Radius=0)  # -> Rectangle, Length
rectangle_2 = Rectangle(Plane=pt_3, XSize=Domain(0, 6.5), YSize=Domain(0, 2.1), Radius=0)  # -> Rectangle, Length
brep = Brep(rectangle.Rectangle)
brep_2 = Brep(rectangle_2.Rectangle)
mod = Modulus(A=c_script.TC, B=2)
filter = StreamFilter(Gate=mod, Stream0=brep_2, Stream1=brep)
